# Grasshopper definition CreateSliceSurface.gh (Grasshopper 1.0.8)
# plug-ins: RhinoCodePluginGH

srf = Surface(<surface referenced from the Rhino model>)
edges = BrepEdges(Brep=srf)  # -> Naked, Interior, NonManifold
int = Integer(0)
int_2 = Integer(1)
int_3 = Integer(2)
int_4 = Integer(3)
item = ListItem(List=edges.Naked, Index=int, Wrap=True)
item_2 = ListItem(List=edges.Naked, Index=int_2, Wrap=True)
item_3 = ListItem(List=edges.Naked, Index=int_3, Wrap=True)
item_4 = ListItem(List=edges.Naked, Index=int_4, Wrap=True)
edgesrf = EdgeSurface(CurveA=item, CurveB=item_2, CurveC=item_3, CurveD=item_4)
srf_2 = Surface(edgesrf)
srf_3 = Surface(srf_2)
domain² = Domain²(srf_3)
dedom2 = DeconstructDomain²(Domain=domain²)  # -> UComponent, VComponent
surfaceonpoints = Python3Script(srf=srf_3, udom=dedom2.UComponent, vdom=dedom2.VComponent)  # -> out, pnts; inputs srf: Surface
# ---------- surfaceonpoints: Python ----------
import ghpythonlib.components as ghc

obj = ghc.SurfacePoints(srf)

cnt_pnts = obj[0]
nx = obj[3] * 2
ny = obj[4] * 2
px = []
py = []
pz = []
for j in range(ny):
    px.append([])
    py.append([])
    pz.append([])

pnts = []
for i in range(nx):
    for j in range(ny):
        u = (udom[1] - udom[0]) / (nx - 1) * i + udom[0]
        v = (vdom[1] - vdom[0]) / (ny - 1) * j + vdom[0]
        pnt = ghc.EvaluateSurface(srf, ghc.ConstructPoint(u, v, 0.0))[0]
        pnts.append(pnt)
        px[j].append(pnt[0])
        py[j].append(pnt[1])
        pz[j].append(pnt[2])

print('2')
print('{0:d},{1:d}'.format(nx,ny))

for j in range(ny):
    sub = ''
    for i in range(nx):
        if i == 0:
            sub = '{0:.3f}'.format(px[j][i])
        else:
            sub = '{0},{1:.3f}'.format(sub, px[j][i])
    print(sub)

for j in range(ny):
    sub = ''
    for i in range(nx):
        if i == 0:
            sub = '{0:.3f}'.format(py[j][i])
        else:
            sub = '{0},{1:.3f}'.format(sub, py[j][i])
    print(sub)

for j in range(ny):
    sub = ''
    for i in range(nx):
        if i == 0:
            sub = '{0:.3f}'.format(pz[j][i])
        else:
            sub = '{0},{1:.3f}'.format(sub, pz[j][i])
    print(sub)
# ---------- end surfaceonpoints ----------
surfacecontrolpoints = Python3Script(srf=srf_3)  # -> out, pnts; inputs srf: Surface
# ---------- surfacecontrolpoints: Python ----------
import ghpythonlib.components as ghc

obj = ghc.SurfacePoints(srf)

pnts = obj[0]
nx = obj[3]
ny = obj[4]
px = []
py = []
pz = []
for j in range(ny):
    px.append([])
    py.append([])
    pz.append([])

for j in range(ny):
    for i in range(nx):
        idx = i * ny + j
        px[j].append(pnts[idx][0])
        py[j].append(pnts[idx][1])
        pz[j].append(pnts[idx][2])



print('2')
print('{0:d},{1:d}'.format(nx,ny))

for j in range(ny):
    sub = ''
    for i in range(nx):
        if i == 0:
            sub = '{0:.3f}'.format(px[j][i])
        else:
            sub = '{0},{1:.3f}'.format(sub, px[j][i])
    print(sub)

for j in range(ny):
    sub = ''
    for i in range(nx):
        if i == 0:
            sub = '{0:.3f}'.format(py[j][i])
        else:
            sub = '{0},{1:.3f}'.format(sub, py[j][i])
    print(sub)

for j in range(ny):
    sub = ''
    for i in range(nx):
        if i == 0:
            sub = '{0:.3f}'.format(pz[j][i])
        else:
            sub = '{0},{1:.3f}'.format(sub, pz[j][i])
    print(sub)
# ---------- end surfacecontrolpoints ----------
# Right click and "Copy data only"
panel = Panel(surfaceonpoints.out)
